# Grasshopper definition Script testing.gh (Grasshopper 1.0.8)
# plug-ins: Heron

file_path = FilePath("\"C:\\Users\\Thijs W\\Desktop\\Minor Digitalisering in de Gebouwde Omgeving\\Project 3\\Primo Levihof.lyrx\"")

panel = Panel("Heron geometry export")
integer = Integer(3)
number = Number(1)
number_2 = Number(0)
panel_2 = Panel("""12
18
9""")
panel_3 = Panel("""Lab A
Lab B
Lab C""")
series = Series(Start=number_2, Step=number, Count=integer)
panel_4 = Panel("""id
naam
hoogte_m""")
file_path_2 = FilePath("C:\Users\Thijs W\Desktop\Heron\")
entwine = Entwine(Branch00=series, Branch01=panel_3, Branch02=panel_2, FlattenInputs=True)
curve = Curve([<curve referenced from the Rhino model> x72])
export_vector = ExportVector(
    VectorDataFilename="gebouwen",
    VectorDataFolder=file_path_2,
    Fields=panel_4,
    Values=entwine,
    FeatureGeometry=curve,
    Export=True,
    DriverExtension=".geojson",
    DriverType="GeoJSON",
    ExportCurveAsPolygon=True)
panel_5 = Panel(export_vector)

panel_6 = Panel("Input geometry")
import_vector = ImportVector(FilePath=file_path, ClipIt=True, PointsOnly=False)  # -> DataExtents, Fields, Values, FeatureGeometry
file_path_3 = FilePath("C:\Users\Thijs W\Desktop\Heron\Primo Levihof_FeaturesToJSON_FOR_ARCGIS.geojson")
# Python Heron geometry 3d export
text = Text(export_vector)
panel_7 = Panel("https://services9.arcgis.com/nqW2A97fCpeCbw6Z/arcgis/rest/services/Grasshopper_polygon_heron/FeatureServer")
panel_8 = Panel("https://services9.arcgis.com/nqW2A97fCpeCbw6Z/arcgis/rest/services/Grasshopper_polygon_heron/FeatureServer")
panel_9 = Panel("Python Scripts")

# ----
# Python script automatic export proces
panel_10 = Panel("https://services9.arcgis.com/nqW2A97fCpeCbw6Z/arcgis/rest/services/Grasshopper_heron_live/FeatureServer")
file_path_4 = FilePath("\"C:\\Users\\Thijs W\\Desktop\\Heron\"")
python_3_script = Python3Script(export_folder=file_path_4, feature_service_url=panel_10, run_button=True)  # -> a, b, c; inputs run_button: Boolean
# ---------- python_3_script: Python ----------
"""
HERON → ARCGIS ONLINE LIVE SYNC
================================

Synchroniseert GeoJSON van Heron direct naar ArcGIS Online
Geen pip imports, geen API keys, geen inloggegevens

Alleen standaard Python libraries:
- json
- urllib
- zipfile
- glob
- os

GRASSHOPPER INPUTS:
- export_folder: Waar Heron Export Vector files maakt
- feature_service_url: Je ArcGIS Feature Service URL
- reference_lat: Latitude (optional, default 51.9045)
- reference_lon: Longitude (optional, default 4.5220)

GRASSHOPPER OUTPUTS:
- a: True/False (success)
- b: Message (tekst)
"""

import json
import urllib.request
import urllib.parse
import os
import glob
import zipfile


class HeronArcGISSync:
    """Synchroniseert Heron GeoJSON naar ArcGIS Online"""
    
    def __init__(self, feature_service_url, reference_lat=51.9045, reference_lon=4.5220):
        """Initialize sync handler"""
        self.feature_service_url = feature_service_url.rstrip('/')
        self.reference_lat = reference_lat
        self.reference_lon = reference_lon
        self.meters_per_degree = 111000
    
    def find_geojson(self, export_folder):
        """Find GeoJSON files in folder"""
        geojson_files = glob.glob(os.path.join(export_folder, "*.geojson"))
        geojson_files += glob.glob(os.path.join(export_folder, "*.json"))
        return geojson_files
    
    def read_geojson(self, geojson_path):
        """Read GeoJSON file"""
        try:
            with open(geojson_path, 'r', encoding='utf-8') as f:
                data = json.load(f)
            return data
        except Exception as e:
            return None
    
    def geojson_to_features(self, geojson_data):
        """Convert GeoJSON to ArcGIS features"""
        features = []
        
        if not geojson_data or 'features' not in geojson_data:
            return features
        
        for feature in geojson_data['features']:
            try:
                geometry = feature.get('geometry', {})
                properties = feature.get('properties', {})
                
                # Convert GeoJSON geometry to ArcGIS format
                arcgis_feature = {
                    'geometry': self._convert_geometry(geometry),
                    'attributes': properties
                }
                
                features.append(arcgis_feature)
            except Exception as e:
                continue
        
        return features
    
    def _convert_geometry(self, geojson_geom):
        """Convert GeoJSON geometry to ArcGIS REST format"""
        if not geojson_geom:
            return {}
        
        geom_type = geojson_geom.get('type', '').lower()
        coords = geojson_geom.get('coordinates', [])
        
        if geom_type == 'polygon':
            # Polygon: rings format
            return {
                'rings': coords,
                'spatialReference': {'wkid': 4326}
            }
        elif geom_type == 'multipolygon':
            # MultiPolygon: use first polygon
            if coords:
                return {
                    'rings': coords[0],
                    'spatialReference': {'wkid': 4326}
                }
        elif geom_type == 'point':
            # Point
            if len(coords) >= 2:
                return {
                    'x': coords[0],
                    'y': coords[1],
                    'spatialReference': {'wkid': 4326}
                }
        elif geom_type == 'linestring':
            # LineString: paths format
            return {
                'paths': [coords],
                'spatialReference': {'wkid': 4326}
            }
        
        return {}
    
    def get_existing_features(self, layer_id=0):
        """Get all existing features from ArcGIS"""
        try:
            url = f"{self.feature_service_url}/{layer_id}/query"
            
            data = urllib.parse.urlencode({
                'where': '1=1',
                'returnIdsOnly': 'true',
                'f': 'json'
            }).encode('utf-8')
            
            req = urllib.request.Request(url, data=data)
            req.add_header('Content-Type', 'application/x-www-form-urlencoded')
            
            with urllib.request.urlopen(req, timeout=30) as response:
                result = json.loads(response.read().decode('utf-8'))
            
            if 'objectIds' in result:
                return result['objectIds']
            return []
        
        except Exception as e:
            return []
    
    def delete_features(self, object_ids, layer_id=0):
        """Delete features from ArcGIS by ObjectID"""
        if not object_ids:
            return 0
        
        try:
            url = f"{self.feature_service_url}/{layer_id}/deleteFeatures"
            
            # Convert to comma-separated string
            ids_str = ','.join(str(id) for id in object_ids)
            
            data = urllib.parse.urlencode({
                'objectIds': ids_str,
                'f': 'json'
            }).encode('utf-8')
            
            req = urllib.request.Request(url, data=data)
            req.add_header('Content-Type', 'application/x-www-form-urlencoded')
            
            with urllib.request.urlopen(req, timeout=30) as response:
                result = json.loads(response.read().decode('utf-8'))
            
            if 'deleteResults' in result:
                deleted = sum(1 for r in result['deleteResults'] if r.get('success', False))
                return deleted
            return 0
        
        except Exception as e:
            return 0
    
    def upload_features(self, features, layer_id=0):
        """Upload features to ArcGIS Online"""
        if not features:
            return False, "No features to upload"
        
        try:
            # Prepare request
            url = f"{self.feature_service_url}/{layer_id}/addFeatures"
            
            # Convert to JSON
            features_json = json.dumps(features)
            
            # URL encode
            data = urllib.parse.urlencode({
                'features': features_json,
                'f': 'json'
            }).encode('utf-8')
            
            # Send request
            req = urllib.request.Request(url, data=data)
            req.add_header('Content-Type', 'application/x-www-form-urlencoded')
            
            with urllib.request.urlopen(req, timeout=30) as response:
                result = json.loads(response.read().decode('utf-8'))
            
            # Check result
            if 'addResults' in result:
                successful = sum(1 for r in result['addResults'] if r.get('success', False))
                return True, f"Success: {successful} features uploaded"
            else:
                return False, f"Upload failed: {str(result)}"
        
        except Exception as e:
            return False, f"Error: {str(e)}"
    
    def sync(self, export_folder, layer_id=0):
        """Full sync process with DELETE support"""
        # Check folder
        if not os.path.exists(export_folder):
            return False, f"Folder not found: {export_folder}"
        
        # Find GeoJSON
        geojson_files = self.find_geojson(export_folder)
        if not geojson_files:
            return False, f"No .geojson files in: {export_folder}"
        
        # Use first file
        geojson_path = geojson_files[0]
        
        # Read GeoJSON
        geojson_data = self.read_geojson(geojson_path)
        if not geojson_data:
            return False, f"Could not read: {os.path.basename(geojson_path)}"
        
        # Convert to ArcGIS features
        new_features = self.geojson_to_features(geojson_data)
        if not new_features:
            return False, "No valid features found in GeoJSON"
        
        # Get existing features from ArcGIS
        existing_ids = self.get_existing_features(layer_id)
        
        # Delete old features if any exist and new ones don't match
        deleted_count = 0
        if existing_ids:
            # Keep it simple: delete all old, add all new (full replace)
            deleted_count = self.delete_features(existing_ids, layer_id)
        
        # Upload new features
        success, message = self.upload_features(new_features, layer_id)
        
        # Combine results
        if success and deleted_count > 0:
            return True, f"Deleted: {deleted_count} | Added: {message.split(':')[1].strip()}"
        elif success:
            return True, message
        else:
            return False, message


# ═══════════════════════════════════════════════════════════════════
# GRASSHOPPER MAIN CODE (run this in Grasshopper Python component)
# ═══════════════════════════════════════════════════════════════════

try:
    # Get inputs
    export_folder = export_folder.strip('"').strip("'") if export_folder else None
    feature_service_url = feature_service_url.strip('"').strip("'") if feature_service_url else None
    lat = float(reference_lat) if reference_lat else 51.9045
    lon = float(reference_lon) if reference_lon else 4.5220
    lid = int(layer_id) if layer_id else 0
    
    # Check for button input (optional)
    # If button input exists and is False, don't run
    run = True
    try:
        if 'run_button' in dir() and run_button is not None:
            run = bool(run_button)
    except:
        pass
    
    # Validate other inputs
    if not export_folder or not feature_service_url:
        a = False
        b = "ERROR: Missing inputs (export_folder and feature_service_url required)"
    elif not run:
        # Button not pressed, don't execute
        a = False
        b = "Waiting for button click..."
    else:
        # Create syncer
        syncer = HeronArcGISSync(feature_service_url, lat, lon)
        
        # Sync
        success, message = syncer.sync(export_folder, lid)
        
        a = success
        b = message

except Exception as e:
    a = False
    b = f"Exception: {str(e)}"
# ---------- end python_3_script ----------
panel_11 = Panel(python_3_script.a)
panel_12 = Panel(python_3_script.b)

number_3 = Number(51.905)
number_4 = Number(4.467)
number_5 = Number(30)
number_6 = Number(-25)
number_7 = Number(0)
number_8 = Number(1)
python_3_script_2 = Python3Script(
    geojson_path=file_path_3,
    feature_service_url=panel_7,
    center_lon=number_4,
    center_lat=number_3,
    building_spacing=number_5,
    run_export=True)  # -> result; inputs run_export: Boolean
# ---------- python_3_script_2: Python ----------
# GRASSHOPPER PYTHON COMPONENT CODE - HERON 3D EXPORTER
# WITH FLEXIBLE COORDINATE TRANSFORMATION
# ===========================================================
# Kopieeer dit EXACT in je Python component in Grasshopper
# Versie: 4.0 (Flexible coordinates, any export file)

import sys
import os
import json
import importlib.util

# ===== CONFIGURE YOUR SETTINGS =====
SCRIPT_FOLDER = r'C:\Users\Thijs W\Documents\Heron'
# ====================================

# Add to path
if SCRIPT_FOLDER not in sys.path:
    sys.path.insert(0, SCRIPT_FOLDER)


# ============================================================
# COORDINATE TRANSFORMATION
# ============================================================
# Presets for common locations:
# - Rotterdam Lombardijen: center [4.4670, 51.9050]
# - Amsterdam: [4.8952, 52.3676]

def transform_coordinates(geojson_data, scale_xy, offset_x, offset_y, center_lon, center_lat, spacing_meters=0):
    """
    Transform GeoJSON coordinates from model-space to real-world GPS
    
    scale_xy: How many meters per unit in your model (e.g., 1.0 if model is in meters)
    offset_x, offset_y: Model coordinates of origin point (e.g., -25, 0 for model center)
    center_lon, center_lat: Where to place it on Earth (e.g., 4.4670, 51.9050 for Rotterdam)
    spacing_meters: Distance to space out buildings (e.g., 30 = 30m apart)
    """
    
    # For Rotterdam area: 1 degree lon ≈ 73 km, 1 degree lat ≈ 111 km
    meters_per_degree_lon = 73000
    meters_per_degree_lat = 111000
    
    new_features = []
    feature_index = 0
    
    for feature in geojson_data.get('features', []):
        geom = feature.get('geometry', {})
        geom_type = geom.get('type', '')
        
        # Transform coordinates based on geometry type
        if geom_type == 'MultiLineString':
            # Extract height from Z, use XY as base
            lines = geom.get('coordinates', [])
            all_z = []
            all_points = []
            
            # Collect all unique XY points and Z values
            seen = set()
            for line in lines:
                for coord in line:
                    x = float(coord[0])
                    y = float(coord[1])
                    key = (round(x, 8), round(y, 8))
                    
                    if key not in seen:
                        all_points.append([x, y])
                        seen.add(key)
                    
                    # Extract Z for height
                    if len(coord) > 2:
                        all_z.append(float(coord[2]))
            
            # Skip if not enough points
            if len(all_points) < 3:
                feature_index += 1
                continue
            
            # Transform all points to GPS
            base_coords = []
            for point in all_points:
                model_x = (point[0] - offset_x) * scale_xy
                model_y = (point[1] - offset_y) * scale_xy
                
                # Add spacing based on building index
                spacing_lon = (spacing_meters / meters_per_degree_lon) * (feature_index % 3)
                spacing_lat = (spacing_meters / meters_per_degree_lat) * (feature_index // 3)
                
                # Convert meters to degrees
                lon = center_lon + (model_x / meters_per_degree_lon) + spacing_lon
                lat = center_lat + (model_y / meters_per_degree_lat) + spacing_lat
                
                base_coords.append([lon, lat])
            
            # Calculate height
            height = 0
            if all_z:
                try:
                    height = max(all_z) - min(all_z)
                except:
                    height = 0
            
            # Ensure polygon is closed
            if base_coords[0] != base_coords[-1]:
                base_coords.append(base_coords[0])
            
            # Create feature
            new_feature = {
                "type": "Feature",
                "properties": {
                    "name": feature.get('properties', {}).get('naam', 'Building'),
                    "height": round(height, 2)
                },
                "geometry": {
                    "type": "Polygon",
                    "coordinates": [base_coords]
                }
            }
            new_features.append(new_feature)
            feature_index += 1
        
        elif geom_type == 'Polygon':
            # Transform existing polygon
            coords = geom.get('coordinates', [])
            new_coords = []
            all_z = []
            
            for ring in coords:
                new_ring = []
                for coord in ring:
                    model_x = (float(coord[0]) - offset_x) * scale_xy
                    model_y = (float(coord[1]) - offset_y) * scale_xy
                    
                    lon = center_lon + (model_x / meters_per_degree_lon)
                    lat = center_lat + (model_y / meters_per_degree_lat)
                    
                    new_ring.append([lon, lat])
                    
                    if len(coord) > 2:
                        all_z.append(float(coord[2]))
                
                new_coords.append(new_ring)
            
            # Get height
            height = 0
            try:
                height = float(feature.get('properties', {}).get('height', 0) or 0)
            except:
                height = 0
            
            if height == 0 and all_z:
                try:
                    height = max(all_z) - min(all_z)
                except:
                    height = 0
            
            feature['geometry']['coordinates'] = new_coords
            feature['properties']['height'] = round(float(height), 2)
            new_features.append(feature)
    
    return {
        "type": "FeatureCollection",
        "features": new_features
    }


# ============================================================
# MAIN EXPORT FUNCTION
# ============================================================

try:
    # Set defaults if inputs not connected
    if 'geojson_path' not in dir() or geojson_path is None:
        geojson_path = ""
    
    if 'feature_service_url' not in dir() or feature_service_url is None:
        feature_service_url = ""
    
    if 'scale_xy' not in dir() or scale_xy is None:
        scale_xy = 1.0
    else:
        scale_xy = float(scale_xy)
    
    if 'offset_x' not in dir() or offset_x is None:
        offset_x = 0
    else:
        offset_x = float(offset_x)
    
    if 'offset_y' not in dir() or offset_y is None:
        offset_y = 0
    else:
        offset_y = float(offset_y)
    
    if 'center_lon' not in dir() or center_lon is None:
        center_lon = 4.4670
    else:
        center_lon = float(center_lon)
    
    if 'center_lat' not in dir() or center_lat is None:
        center_lat = 51.9050
    else:
        center_lat = float(center_lat)
    
    if 'building_spacing' not in dir() or building_spacing is None:
        building_spacing = 0.0
    else:
        building_spacing = float(building_spacing)
    
    if 'run_export' not in dir() or run_export is None:
        run_export = False
    
    # Try to import the exporter
    try:
        from HERON_3D_EXPORTER_FINAL import Heron3DExporter
    except ImportError:
        module_path = os.path.join(SCRIPT_FOLDER, 'HERON_3D_EXPORTER_FINAL.py')
        spec = importlib.util.spec_from_file_location("HERON_3D_EXPORTER_FINAL", module_path)
        module = importlib.util.module_from_spec(spec)
        spec.loader.exec_module(module)
        Heron3DExporter = module.Heron3DExporter
    
    # Validate inputs
    if not geojson_path:
        result = "ERROR: geojson_path input is missing!"
        
    elif not feature_service_url:
        result = "ERROR: feature_service_url input is missing!"
        
    elif not os.path.exists(geojson_path):
        result = "ERROR: File not found: " + str(geojson_path)
        
    elif not run_export:
        result = "INFO: Export is paused. Set run_export = True"
        
    else:
        result = ""
        
        # STEP 1: Read GeoJSON
        try:
            with open(geojson_path, 'r', encoding='utf-8') as f:
                geojson_data = json.load(f)
            result += "[OK] Loaded GeoJSON: " + os.path.basename(geojson_path) + "\n"
        except Exception as e:
            result += "[ERROR] Could not read GeoJSON: " + str(e)
            geojson_data = None
        
        if geojson_data:
            # STEP 2: Transform coordinates
            try:
                transformed_data = transform_coordinates(
                    geojson_data,
                    scale_xy=scale_xy,
                    offset_x=offset_x,
                    offset_y=offset_y,
                    center_lon=center_lon,
                    center_lat=center_lat,
                    spacing_meters=building_spacing
                )
                result += "[OK] Transformed coordinates to GPS\n"
                result += "     Center: [{:.4f}, {:.4f}]\n".format(center_lon, center_lat)
                result += "     Scale: {}x, Offset: ({}, {}), Spacing: {}m\n".format(scale_xy, offset_x, offset_y, building_spacing)
                result += "     Features created: {}\n\n".format(len(transformed_data.get('features', [])))
            except Exception as e:
                result += "[ERROR] Transformation failed: " + str(e) + "\n"
                import traceback
                result += traceback.format_exc() + "\n"
                transformed_data = geojson_data
            
            # STEP 3: Save intermediate file
            try:
                output_path = os.path.splitext(geojson_path)[0] + "_TRANSFORMED.geojson"
                with open(output_path, 'w', encoding='utf-8') as f:
                    json.dump(transformed_data, f, indent=2)
            except Exception as e:
                result += "[!] Could not save temp file: " + str(e) + "\n"
                output_path = geojson_path
            
            # STEP 4: Upload to ArcGIS
            exporter = Heron3DExporter(feature_service_url)
            success, message = exporter.export_3d(output_path)
            
            if success:
                result += "SUCCESS!\n"
                result += message
                result += "\n\nCheck ArcGIS Scene Viewer (3D mode)!"
            else:
                result += "EXPORT FAILED!\n"
                result += message

except ImportError as e:
    result = "ERROR: Could not import Heron3DExporter!\n"
    result += str(e)

except Exception as e:
    result = "ERROR: Unexpected error!\n"
    result += str(e)
# ---------- end python_3_script_2 ----------
python_3_script_3 = Python3Script()  # -> out, a; unedited script template
panel_13 = Panel(python_3_script_2)
panel_14 = Panel("https://services9.arcgis.com/nqW2A97fCpeCbw6Z/arcgis/rest/services/Grasshopper_polygon_heron/FeatureServer")
panel_15 = Panel("https://services9.arcgis.com/nqW2A97fCpeCbw6Z/arcgis/rest/services/Grasshopper_polygon_heron/FeatureServer")
python_3_script_4 = Python3Script(feature_service_url=panel_14, run_export=True)  # -> result; inputs run_export: Boolean
# ---------- python_3_script_4: Python ----------
# GRASSHOPPER PYTHON COMPONENT CODE - HERON 3D EXPORTER
# WITH FLEXIBLE COORDINATE TRANSFORMATION
# ===========================================================
# Kopieeer dit EXACT in je Python component in Grasshopper
# Versie: 4.0 (Flexible coordinates, any export file)

import sys
import os
import json
import importlib.util

# ===== CONFIGURE YOUR SETTINGS =====
SCRIPT_FOLDER = r'C:\Users\Thijs W\Documents\Heron'
# ====================================

# Add to path
if SCRIPT_FOLDER not in sys.path:
    sys.path.insert(0, SCRIPT_FOLDER)


# ============================================================
# COORDINATE TRANSFORMATION
# ============================================================
# Presets for common locations:
# - Rotterdam Lombardijen: center [4.4670, 51.9050]
# - Amsterdam: [4.8952, 52.3676]

def transform_coordinates(geojson_data, scale_xy, offset_x, offset_y, center_lon, center_lat, spacing_meters=0):
    """
    Transform GeoJSON coordinates from model-space to real-world GPS
    
    scale_xy: How many meters per unit in your model (e.g., 1.0 if model is in meters)
    offset_x, offset_y: Model coordinates of origin point (e.g., -25, 0 for model center)
    center_lon, center_lat: Where to place it on Earth (e.g., 4.4670, 51.9050 for Rotterdam)
    spacing_meters: Distance to space out buildings (e.g., 30 = 30m apart)
    """
    
    # For Rotterdam area: 1 degree lon ≈ 73 km, 1 degree lat ≈ 111 km
    meters_per_degree_lon = 73000
    meters_per_degree_lat = 111000
    
    new_features = []
    feature_index = 0
    
    for feature in geojson_data.get('features', []):
        geom = feature.get('geometry', {})
        geom_type = geom.get('type', '')
        
        # Transform coordinates based on geometry type
        if geom_type == 'MultiLineString':
            # Extract height from Z, use XY as base
            lines = geom.get('coordinates', [])
            all_z = []
            base_coords = []
            seen = set()
            
            for line_idx, line in enumerate(lines):
                for coord in line:
                    # Transform XY to GPS
                    model_x = (float(coord[0]) - offset_x) * scale_xy
                    model_y = (float(coord[1]) - offset_y) * scale_xy
                    
                    # Add spacing based on line index to scatter geometry
                    spacing_lon = (spacing_meters / meters_per_degree_lon) * (line_idx % 3)
                    spacing_lat = (spacing_meters / meters_per_degree_lat) * (line_idx // 3)
                    
                    # Convert meters to degrees
                    lon = center_lon + (model_x / meters_per_degree_lon) + spacing_lon
                    lat = center_lat + (model_y / meters_per_degree_lat) + spacing_lat
                    
                    key = (round(lon, 10), round(lat, 10))
                    if key not in seen:
                        base_coords.append([lon, lat])
                        seen.add(key)
                    
                    # Extract Z for height
                    if len(coord) > 2:
                        all_z.append(float(coord[2]))
            
            # Calculate height
            height = 0
            if all_z:
                try:
                    height = max(all_z) - min(all_z)
                except:
                    height = 0
            
            # Ensure closed
            if base_coords and base_coords[0] != base_coords[-1]:
                base_coords.append(base_coords[0])
            
            # Create feature
            new_feature = {
                "type": "Feature",
                "properties": {
                    "name": feature.get('properties', {}).get('naam', 'Building'),
                    "height": round(height, 2)
                },
                "geometry": {
                    "type": "Polygon",
                    "coordinates": [base_coords]
                }
            }
            new_features.append(new_feature)
            feature_index += 1
        
        elif geom_type == 'Polygon':
            # Transform existing polygon
            coords = geom.get('coordinates', [])
            new_coords = []
            all_z = []
            
            for ring in coords:
                new_ring = []
                for coord in ring:
                    model_x = (float(coord[0]) - offset_x) * scale_xy
                    model_y = (float(coord[1]) - offset_y) * scale_xy
                    
                    lon = center_lon + (model_x / meters_per_degree_lon)
                    lat = center_lat + (model_y / meters_per_degree_lat)
                    
                    new_ring.append([lon, lat])
                    
                    if len(coord) > 2:
                        all_z.append(float(coord[2]))
                
                new_coords.append(new_ring)
            
            # Get height
            height = 0
            try:
                height = float(feature.get('properties', {}).get('height', 0) or 0)
            except:
                height = 0
            
            if height == 0 and all_z:
                try:
                    height = max(all_z) - min(all_z)
                except:
                    height = 0
            
            feature['geometry']['coordinates'] = new_coords
            feature['properties']['height'] = round(float(height), 2)
            new_features.append(feature)
    
    return {
        "type": "FeatureCollection",
        "features": new_features
    }


# ============================================================
# MAIN EXPORT FUNCTION
# ============================================================

try:
    # Set defaults if inputs not connected
    if 'geojson_path' not in dir() or geojson_path is None:
        geojson_path = ""
    
    if 'feature_service_url' not in dir() or feature_service_url is None:
        feature_service_url = ""
    
    if 'scale_xy' not in dir() or scale_xy is None:
        scale_xy = 1.0
    else:
        scale_xy = float(scale_xy)
    
    if 'offset_x' not in dir() or offset_x is None:
        offset_x = 0
    else:
        offset_x = float(offset_x)
    
    if 'offset_y' not in dir() or offset_y is None:
        offset_y = 0
    else:
        offset_y = float(offset_y)
    
    if 'center_lon' not in dir() or center_lon is None:
        center_lon = 4.4670
    else:
        center_lon = float(center_lon)
    
    if 'center_lat' not in dir() or center_lat is None:
        center_lat = 51.9050
    else:
        center_lat = float(center_lat)
    
    if 'building_spacing' not in dir() or building_spacing is None:
        building_spacing = 0.0
    else:
        building_spacing = float(building_spacing)
    
    if 'run_export' not in dir() or run_export is None:
        run_export = False
    
    # Try to import the exporter
    try:
        from HERON_3D_EXPORTER_FINAL import Heron3DExporter
    except ImportError:
        module_path = os.path.join(SCRIPT_FOLDER, 'HERON_3D_EXPORTER_FINAL.py')
        spec = importlib.util.spec_from_file_location("HERON_3D_EXPORTER_FINAL", module_path)
        module = importlib.util.module_from_spec(spec)
        spec.loader.exec_module(module)
        Heron3DExporter = module.Heron3DExporter
    
    # Validate inputs
    if not geojson_path:
        result = "ERROR: geojson_path input is missing!"
        
    elif not feature_service_url:
        result = "ERROR: feature_service_url input is missing!"
        
    elif not os.path.exists(geojson_path):
        result = "ERROR: File not found: " + str(geojson_path)
        
    elif not run_export:
        result = "INFO: Export is paused. Set run_export = True"
        
    else:
        result = ""
        
        # STEP 1: Read GeoJSON
        try:
            with open(geojson_path, 'r', encoding='utf-8') as f:
                geojson_data = json.load(f)
            result += "[OK] Loaded GeoJSON: " + os.path.basename(geojson_path) + "\n"
        except Exception as e:
            result += "[ERROR] Could not read GeoJSON: " + str(e)
            geojson_data = None
        
        if geojson_data:
            # STEP 2: Transform coordinates
            try:
                transformed_data = transform_coordinates(
                    geojson_data,
                    scale_xy=scale_xy,
                    offset_x=offset_x,
                    offset_y=offset_y,
                    center_lon=center_lon,
                    center_lat=center_lat,
                    spacing_meters=building_spacing
                )
                result += "[OK] Transformed coordinates to GPS\n"
                result += "     Center: [{:.4f}, {:.4f}]\n".format(center_lon, center_lat)
                result += "     Scale: {}x, Offset: ({}, {}), Spacing: {}m\n\n".format(scale_xy, offset_x, offset_y, building_spacing)
            except Exception as e:
                result += "[ERROR] Transformation failed: " + str(e)
                transformed_data = geojson_data
            
            # STEP 3: Save intermediate file
            try:
                output_path = os.path.splitext(geojson_path)[0] + "_TRANSFORMED.geojson"
                with open(output_path, 'w', encoding='utf-8') as f:
                    json.dump(transformed_data, f, indent=2)
            except Exception as e:
                result += "[!] Could not save temp file: " + str(e) + "\n"
                output_path = geojson_path
            
            # STEP 4: Upload to ArcGIS
            exporter = Heron3DExporter(feature_service_url)
            success, message = exporter.export_3d(output_path)
            
            if success:
                result += "SUCCESS!\n"
                result += message
                result += "\n\nCheck ArcGIS Scene Viewer (3D mode)!"
            else:
                result += "EXPORT FAILED!\n"
                result += message

except ImportError as e:
    result = "ERROR: Could not import Heron3DExporter!\n"
    result += str(e)

except Exception as e:
    result = "ERROR: Unexpected error!\n"
    result += str(e)
# ---------- end python_3_script_4 ----------
python_3_script_5 = Python3Script(feature_service_url=panel_15, run_export=True)  # -> result; inputs run_export: Boolean
# ---------- python_3_script_5: Python ----------
# GRASSHOPPER PYTHON COMPONENT CODE - HERON 3D EXPORTER
# ===========================================================
# Kopieeer dit EXACT in je Python component in Grasshopper
# Versie: 2.0 (Windows-proof, goed getest)

import sys
import os
import importlib.util

# ===== CONFIGURE YOUR USERNAME HERE =====
# Bijvoorbeeld: C:\Users\JohnDoe\Documents\Heron
SCRIPT_FOLDER = r'C:\Users\Thijs W\Documents\Heron'
# =========================================

# Add to path
if SCRIPT_FOLDER not in sys.path:
    sys.path.insert(0, SCRIPT_FOLDER)

try:
    # Try to import the exporter with fallback method
    try:
        from HERON_3D_EXPORTER_FINAL import Heron3DExporter
    except ImportError:
        # Fallback: direct load from file
        module_path = os.path.join(SCRIPT_FOLDER, 'HERON_3D_EXPORTER_FINAL.py')
        spec = importlib.util.spec_from_file_location("HERON_3D_EXPORTER_FINAL", module_path)
        module = importlib.util.module_from_spec(spec)
        spec.loader.exec_module(module)
        Heron3DExporter = module.Heron3DExporter
    
    # Validate all inputs are provided
    if not geojson_path:
        result = "ERROR: geojson_path input is missing!"
        result += "\nConnect the file path from Heron Export."
        
    elif not feature_service_url:
        result = "ERROR: feature_service_url input is missing!"
        result += "\nProvide your ArcGIS Feature Service URL."
        
    elif not os.path.exists(geojson_path):
        result = "ERROR: File not found!"
        result += "\nPath: " + str(geojson_path)
        result += "\n\nDid Heron Export run successfully?"
        
    elif not run_export:
        result = "INFO: Export is paused."
        result += "\nSet run_export = True to start export."
        
    else:
        # Initialize exporter with the Feature Service URL
        exporter = Heron3DExporter(feature_service_url)
        
        # Run the export
        success, message = exporter.export_3d(geojson_path)
        
        # Format result message
        if success:
            result = "SUCCESS!"
            result += "\n" + message
            result += "\n\nCheck ArcGIS Online Scene Viewer to see your 3D geometry!"
        else:
            result = "FAILED!"
            result += "\n" + message
            result += "\n\nTroubleshooting:"
            result += "\n1. Is Feature Service PUBLIC in ArcGIS Online?"
            result += "\n2. Does GeoJSON file have 'height' field?"
            result += "\n3. Is the URL correct?"
        
        # Add debug info
        if hasattr(exporter, 'debug_log') and exporter.debug_log:
            result += "\n\nDebug Log (last 10 lines):"
            for line in exporter.debug_log[-10:]:
                result += "\n" + line

except ImportError as e:
    result = "ERROR: Could not import Heron3DExporter!"
    result += "\n\nMake sure:"
    result += "\n1. HERON_3D_EXPORTER_FINAL.py exists in:\n   " + SCRIPT_FOLDER
    result += "\n2. SCRIPT_FOLDER path is correct"
    result += "\n3. Replace [YOUR_USERNAME] with actual username"
    result += "\n\nImport Error: " + str(e)
    result += "\n\nDEBUG INFO:"
    result += "\nSCRIPT_FOLDER = " + SCRIPT_FOLDER
    result += "\nExpected file: " + os.path.join(SCRIPT_FOLDER, "HERON_3D_EXPORTER_FINAL.py")
    result += "\nFile exists: " + str(os.path.exists(os.path.join(SCRIPT_FOLDER, "HERON_3D_EXPORTER_FINAL.py")))

except Exception as e:
    result = "ERROR: Unexpected error!"
    result += "\nDetails: " + str(e)
    result += "\n\nDEBUG INFO:"
    result += "\nSCRIPT_FOLDER = " + SCRIPT_FOLDER
    result += "\nFile exists: " + str(os.path.exists(os.path.join(SCRIPT_FOLDER, "HERON_3D_EXPORTER_FINAL.py")))
# ---------- end python_3_script_5 ----------
panel_16 = Panel(python_3_script_4)
panel_17 = Panel(python_3_script_5)
